vi "Main.gviweb"   [LabVIEW NXG 2.1.0]
panel controls:
  "Tab": i32
  "Skyline.Examples.DataServices.int_control": bool
  "Skyline.Examples.DataServices.numeric_slider-control": f64
  "Skyline.Examples.DataServices.string_control": string
  "Hyperlink Control": string = "http://github.com/ni/webvi-examples/tree/master/UtilizeSkylineDataServices"
  "password": string
  "username": string
  "connect": bool
  "server url": string
  "Skyline.Examples.Oven.Inside.Temp-slider-control": f64
  "Skyline.Examples.Oven.Outside.Temp-slider-control": f64
  "Auth Picker": i32
  "API Key": string
panel indicators:
  "Skyline.Examples.DataServices.int_indicator": bool
  "Skyline.Examples.DataServices.numeric_gauge-indicator": f64
  "Skyline.Examples.DataServices.string_indicator": string
  "debugging tips": string
  "Skyline.Examples.Oven.Inside.Temp-tank-indicator": f64
  "Skyline.Examples.Oven.Outside.Temp-tank-indicator": f64
  "Output": error
uses:
  NI::G Core::Error::Clear Error Cluster.gvi
  subvis::Initialize.gvi
  subvis::Read Example Tags.gvi
  subvis::Write Example Tags.gvi
  subvis::Build Error Message.gvi
  subvis::Determine Next State.gvi
diagram:
  # This diagram is idenitcal to Mailn.gvi
  s1 = uninitialised  # shift register
  s2 = uninitialised  # shift register
  s3 = "initialize"  # shift register
  while {
    Wait(time to wait=250)
    $Output <- s1
    case (s3) {
      frame "initialize", Default {
        call "Clear Error Cluster.gvi"(error in=s1) -> (error out=w4)
        # Clear errors and try to connect to the Skyline server.
        sequence {
          frame 0 {
            $"debugging tips" <- ""
          }
        }
        # Read tags first to get their latest value
        call "Initialize.gvi"(server url=$"server url", username=$username, password=$password, api key=$"API Key", AuthPicker=$"Auth Picker", error in=w4) -> (error out=w2, tags=w3)
        w1 = "read-tags"
      }
      frame "read-tags" {
        call "Read Example Tags.gvi"(tags in=s2, error in=s1) -> (tags out=w3, example.skyline-data-services.int_indicator=w5, example.skyline-data-services.numeric_gauge-indicator=w6, example.skyline-data-services.string_indicator=w7, Skyline.Examples.Oven.Inside.Temp-tank-indicator=w8, Skyline.Examples.Oven.Outside.Temp-tank-indicator=w9, error out=w2)
        $"Skyline.Examples.Oven.Outside.Temp-slider-control" <- w9
        # Updates both controls and indicators to ensure that tag values aren't overwritten with stale controls values after switching tabs
        $"Skyline.Examples.DataServices.int_indicator" <- w5
        $"Skyline.Examples.DataServices.int_control" <- w5
        $"Skyline.Examples.DataServices.numeric_gauge-indicator" <- w6
        $"Skyline.Examples.DataServices.numeric_slider-control" <- w6
        $"Skyline.Examples.DataServices.string_indicator" <- w7
        $"Skyline.Examples.DataServices.string_control" <- w7
        $"Skyline.Examples.Oven.Inside.Temp-tank-indicator" <- w8
        $"Skyline.Examples.Oven.Inside.Temp-slider-control" <- w8
        $"Skyline.Examples.Oven.Outside.Temp-tank-indicator" <- w9
        w1 = $Tab
      }
      frame "write-tags" {
        call "Write Example Tags.gvi"(tags in=s2, example.skyline-data-services.int_control=$"Skyline.Examples.DataServices.int_control", example.skyline-data-services.numeric_slider-control=$"Skyline.Examples.DataServices.numeric_slider-control", example.skyline-data-services.string_control=$"Skyline.Examples.DataServices.string_control", Skyline.Examples.Oven.Inside.Temp-slider-control=$"Skyline.Examples.Oven.Inside.Temp-slider-control", Skyline.Examples.Oven.Outside.Temp-slider-control=$"Skyline.Examples.Oven.Outside.Temp-slider-control", error in=s1) -> (tags out=w3, errror out=w2)
        w1 = $Tab
      }
      frame "error-no-skyline" {
        # If there is an error update the user by displaying troubleshooting tips
        call "Build Error Message.gvi"(error in=s1) -> (error out=w2, error state=w10)
        $"debugging tips" <- w10
        w1 = s3
        w3 = s2
      }
    }
    call "Determine Next State.gvi"(state in=w1, connect=$connect, error in=w2) -> (state out=w11, errror out=w12)
    next s1 = w12
    next s2 = w3
    next s3 = w11
    stop if FALSE
  }
